# Grasshopper definition DG_MangoldSemiCircles.gh (Grasshopper 1.0.7)
# plug-ins: Human

timer = Timer(TimerInterval=20, Target=python)

# ---- group: Colored Region Displays
crv = Curve(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)
crv_2 = Curve(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)
crv_3 = Curve(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)
crv_4 = Curve(<curve referenced from the Rhino model>)
createhatch = CreateHatch(Bake=False, Curves=crv_2, HatchPatternName="Solid", HatchScale=1, HatchRotation=0)  # -> HatchGeometry, HatchObjects
createhatch_2 = CreateHatch(Bake=False, Curves=crv_3, HatchPatternName="Solid", HatchScale=1, HatchRotation=0)  # -> HatchGeometry, HatchObjects
createhatch_3 = CreateHatch(Bake=False, Curves=crv_4, HatchPatternName="Solid", HatchScale=1, HatchRotation=0)  # -> HatchGeometry, HatchObjects
createhatch_4 = CreateHatch(Bake=False, Curves=crv, HatchPatternName="Solid", HatchScale=1, HatchRotation=0)  # -> HatchGeometry, HatchObjects
preview = CustomPreview(Geometry=createhatch.HatchGeometry, Material=ColourSwatch(SwatchColor=RGB(255, 98, 57)))
preview_2 = CustomPreview(Geometry=createhatch_2.HatchGeometry, Material=ColourSwatch(SwatchColor=RGB(180, 72, 33)))
preview_3 = CustomPreview(Geometry=createhatch_3.HatchGeometry, Material=ColourSwatch(SwatchColor=RGB(213, 203, 194)))
preview_4 = CustomPreview(Geometry=createhatch_4.HatchGeometry, Material=ColourSwatch(SwatchColor=RGB(2, 111, 150)))

# ----
number_slider = Slider(47.685, range=0..200)
semi_circle_curve = Curve(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)

# ---- group: Scale Factor
number_slider_2 = Slider(0.988, range=0.9..1.1)

# ----
python = PythonScript(toggle=Toggle(True))  # -> out, mp
# ---------- python: Python ----------
import System

if toggle:
    mp = System.Windows.Forms.Control.MousePosition
# ---------- end python ----------
panel = Panel(python.mp)
text_to_remove = Panel("Y=")
text_to_remove_2 = Panel("}")
text_to_remove_3 = Panel("{X=")

comma_to_split = Panel(",")
split = TextSplit(Text=panel, Separators=comma_to_split)
panel_2 = Panel(split)

item = ListItem(List=panel_2, Index=1, Wrap=True)
item_2 = ListItem(List=panel_2, Index=0, Wrap=True)
split_2 = TextSplit(Text=item, Separators=text_to_remove)  # -> flatten(Result)
split_3 = TextSplit(Text=item_2, Separators=text_to_remove_3)  # -> reverse(flatten(Result))
split_4 = TextSplit(Text=split_2, Separators=text_to_remove_2)  # -> reverse(flatten(Result))
item_3 = ListItem(List=split_3, Index=0, Wrap=True)
item_4 = ListItem(List=split_4, Index=-1, Wrap=True)
x_value = Panel(item_3)
y_value = Panel(item_4)
neg = Negative(Value=y_value)
pt = ConstructPoint(XCoordinate=x_value, YCoordinate=neg, ZCoordinate=0)

# ---- group: Central Axis Projection
dom = ConstructDomain(DomainStart=Slider(0, range=0..100), DomainEnd=Slider(2600, range=0..2600))
dom_2 = ConstructDomain(DomainStart=Slider(268, range=0..2600), DomainEnd=Slider(2332, range=0..2600))
remap = RemapNumbers(Value=x_value, Source=dom, Target=dom_2)  # -> Mapped, Clipped
pt_2 = ConstructPoint(XCoordinate=remap.Mapped, YCoordinate="-1440", ZCoordinate=0)
base_point = Point(pt_2)
vec2pt = Vector2Pt(PointA=base_point, PointB=pt, Unitize=False)  # -> Vector, Length
line = LineSDL(Start=base_point, Direction=vec2pt.Vector, Length=Slider(2588, range=0..5000))

# ----
Y = UnitY(Factor=1)
X = UnitX(Factor=1)
neg_2 = Negative(Value=X)
neg_3 = Negative(Value=Y)
line_2 = LineSDL(Start=pt, Direction=neg_3, Length=number_slider)
line_3 = LineSDL(Start=pt, Direction=Y, Length=number_slider)
line_4 = LineSDL(Start=pt, Direction=X, Length=number_slider)
line_5 = LineSDL(Start=pt, Direction=neg_2, Length=number_slider)

# ---- group: Offset Axis Projection
number_slider_3 = Slider(200, range=0..200)
clx = CurveLine(Curve=semi_circle_curve, Line=line)  # -> Points, Params, Count
addition = Addition(A=clx.Params, B=number_slider_3)
subtraction = Subtraction(A=clx.Params, B=number_slider_3)
eval = EvaluateCurve(Curve=semi_circle_curve, Parameter=addition)  # -> Point, Tangent, Angle
eval_2 = EvaluateCurve(Curve=semi_circle_curve, Parameter=subtraction)  # -> Point, Tangent, Angle
vec2pt_2 = Vector2Pt(PointA=clx.Points, PointB=eval.Point, Unitize=False)  # -> Vector, Length
vec2pt_3 = Vector2Pt(PointA=clx.Points, PointB=eval_2.Point, Unitize=False)  # -> Vector, Length
move = Move(Geometry=line, Motion=vec2pt_2.Vector)  # -> Geometry, Transform
number_slider_4 = Slider(1.5, range=0..10)
move_2 = Move(Geometry=line, Motion=vec2pt_3.Vector)  # -> Geometry, Transform
end = EndPoints(Curve=move.Geometry)  # -> Start, End
end_2 = EndPoints(Curve=move_2.Geometry)  # -> Start, End
scale = Scale(Geometry=move.Geometry, Center=end.End, Factor=number_slider_4)  # -> Geometry, Transform
scale_2 = Scale(Geometry=move_2.Geometry, Center=end_2.End, Factor=number_slider_4)  # -> Geometry, Transform

# ----
pt_3 = Point(eval.Point)
pt_4 = Point(eval_2.Point)
pt_5 = Point(end.Start)
pt_6 = Point(end_2.Start)

# ---- group: Generate Ellipse
ln = Line(StartPoint=pt_5, EndPoint=pt_3)
ln_2 = Line(StartPoint=pt_4, EndPoint=pt_6)
pt_7 = Point(clx.Points)
eval_3 = EvaluateCurve(Curve=reparameterize(ln), Parameter=0.5)  # -> Point, Tangent, Angle
eval_4 = EvaluateCurve(Curve=reparameterize(ln_2), Parameter=0.5)  # -> Point, Tangent, Angle
dist = Distance(PointA=pt, PointB=pt_7)
dom_3 = ConstructDomain(DomainStart=Slider(0, range=0..100), DomainEnd=Slider(1455, range=0..10000))
dom_4 = ConstructDomain(DomainStart=Slider(0, range=0..100), DomainEnd=Slider(166, range=0..10000))
ln_3 = Line(StartPoint=eval_3.Point, EndPoint=eval_4.Point)
eval_5 = EvaluateCurve(Curve=ln_3, Parameter=0.5)  # -> Point, Tangent, Angle
remap_2 = RemapNumbers(Value=dist, Source=dom_3, Target=dom_4)  # -> Mapped, Clipped
division = Division(A=remap_2.Mapped, B=Slider(0.102, range=0.001..4))
pl_3pt = Plane3Pt(PointA=eval_5.Point, PointB=pt_7, PointC=eval_4.Point)
dist_2 = Distance(PointA=base_point, PointB=pt_7)
ellipse = Ellipse(Plane=pl_3pt, Radius1=dist_2, Radius2=division)  # -> Ellipse, Focus1, Focus2
eval_6 = EvaluateCurve(Curve=reparameterize(ellipse.Ellipse), Parameter=0)  # -> Point, Tangent, Angle
vec2pt_4 = Vector2Pt(PointA=eval_6.Point, PointB=pt_7, Unitize=False)  # -> Vector, Length
move_3 = Move(Geometry=ellipse.Ellipse, Motion=vec2pt_4.Vector)  # -> Geometry, Transform

# ---- group: Scale Ellipse
bbox = BoundingBox(Content=move_3.Geometry, Plane=PlaneXY(0, 0, 0))  # -> Box, Box_2
debrep = DeconstructBrep(Brep=bbox.Box_2)  # -> Faces, Edges, Vertices
item_5 = ListItem(List=debrep.Edges, Index=0, Wrap=True)
ccx = CurveCurve(CurveA=move_3.Geometry, CurveB=item_5)  # -> Points, ParamsA, ParamsB
boundary_curve = Curve(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)
ln_4 = Line(StartPoint=ccx.Points, EndPoint=pt_7)
ccx_2 = CurveCurve(CurveA=boundary_curve, CurveB=ln_4)  # -> Points, ParamsA, ParamsB
len = Length(Curve=ln_4)
ln_5 = Line(StartPoint=ccx_2.Points, EndPoint=pt_7)
len_2 = Length(Curve=ln_5)
division_2 = Division(A=len_2, B=len)
scale_3 = Scale(Geometry=move_3.Geometry, Center=pt_7, Factor=division_2)  # -> Geometry, Transform

# ---- group: Project Lateral Axis
area = Area(Geometry=scale_3.Geometry)  # -> Area, Centroid
area_2 = Area(Geometry=scale_3.Geometry)  # -> Area, Centroid
eval_7 = EvaluateCurve(Curve=reparameterize(scale_3.Geometry), Parameter=0.26)  # -> Point, Tangent, Angle
ln_6 = Line(StartPoint=area_2.Centroid, EndPoint=eval_7.Point)
line_6 = LineSDL(Start=area_2.Centroid, Direction=ln_6, Length=Slider(2000, range=0..2000))
ccx_3 = CurveCurve(CurveA=scale_3.Geometry, CurveB=line_6)  # -> Points, ParamsA, ParamsB
ccx_4 = CurveCurve(CurveA=semi_circle_curve, CurveB=line_6)  # -> Points, ParamsA, ParamsB

# ---- group: Generate Side Ellipse
ln_7 = Line(StartPoint=ccx_4.Points, EndPoint=ccx_3.Points)
eval_8 = EvaluateCurve(Curve=reparameterize(ln_7), Parameter=0.5)  # -> Point, Tangent, Angle
len_3 = Length(Curve=ln_7)
rotate = Rotate(Geometry=ln_7, Angle=1.570796327, Plane=eval_8.Point)  # -> Geometry, Transform
division_3 = Division(A=len_3, B=Slider(2.721, range=1..10))
end_3 = EndPoints(Curve=rotate.Geometry)  # -> Start, End
pl_3pt_2 = Plane3Pt(PointA=eval_8.Point, PointB=end_3.Start, PointC=ccx_3.Points)
ellipse_2 = Ellipse(Plane=pl_3pt_2, Radius1=division_3, Radius2=len_3)  # -> Ellipse, Focus1, Focus2
eval_9 = EvaluateCurve(Curve=reparameterize(ellipse_2.Ellipse), Parameter=0.25)  # -> Point, Tangent, Angle
vec2pt_5 = Vector2Pt(PointA=eval_9.Point, PointB=ccx_3.Points, Unitize=False)  # -> Vector, Length
move_4 = Move(Geometry=ellipse_2.Ellipse, Motion=vec2pt_5.Vector)  # -> Geometry, Transform
eval_10 = EvaluateCurve(Curve=reparameterize(move_4.Geometry), Parameter=0.75)  # -> Point, Tangent, Angle
dist_3 = Distance(PointA=ccx_3.Points, PointB=ccx_4.Points)
dist_4 = Distance(PointA=ccx_3.Points, PointB=eval_10.Point)
division_4 = Division(A=dist_3, B=dist_4)
multiplication = Multiplication(A=division_4, B=number_slider_2)

# ---- group: Outputs
ellipse_02 = Scale(Geometry=move_4.Geometry, Center=ccx_3.Points, Factor=multiplication)  # -> Geometry, Transform
ellipse_01 = Scale(Geometry=scale_3.Geometry, Center=area.Centroid, Factor=number_slider_2)  # -> Geometry, Transform
